# Grasshopper definition Estudando edifício ortogonal.gh (Grasshopper 0.9.76)
# plug-ins: GhVa10, LunchBox

# ---- group: Projeção do edifício
comprimento_do_edifício = Slider(80, range=0..100)
largura_do_edifício = Slider(20, range=0..100)
pt = ConstructPoint(XCoordinate=0, YCoordinate=0, ZCoordinate=0)
rectangle = Rectangle(Plane=pt, XSize=comprimento_do_edifício, YSize=largura_do_edifício, Radius=0)  # -> Rectangle, Length

# ----
distancia_entre_as_caixas = Slider(0.2, range=0..1)
tamanho_da_nervura = Slider(1, range=0..1)
altura_da_laje = Slider(0.98, range=0..1)

# ---- group: Volumetria
número_de_pavimentos = Slider(5, range=0..10)
pé_direito = Slider(5, range=0..10)
projeção_do_edifício = Curve(rectangle.Rectangle)

# ----
expression = Expression(x=altura_da_laje, Expression="x*-1")
division = Division(A=largura_do_edifício, B=tamanho_da_nervura)
division_2 = Division(A=comprimento_do_edifício, B=tamanho_da_nervura)
Z = UnitZ(Factor=expression)
int = Integer(division)
int_2 = Integer(division_2)
series = Series(Start=0, Step=pé_direito, Count=número_de_pavimentos)
extr = Extrude(Base=rectangle.Rectangle, Direction=Z)
grid = GridStructure(Surface=rectangle.Rectangle, UDivisions=10, VDivisions=10)  # -> StructureLines, StructureNodes
Z_2 = UnitZ(Factor=series)
Z_3 = UnitZ(Factor=pé_direito)
Z_4 = UnitZ(Factor=pé_direito)
cap = CapHoles(Brep=extr)
move = Move(Geometry=projeção_do_edifício, Motion=Z_2)  # -> Geometry, Transform
slabopt = SlabOption(Style={RefHandle=0, RefName=""}, Align=0, Thickness=Slider(0.56, range=0..1))
move_2 = Move(Geometry=move.Geometry, Motion=Z_4)  # -> Geometry, Transform
extr_2 = Extrude(Base=move.Geometry, Direction=Z_3)
cap_2 = CapHoles(Brep=extr_2)
slab = Slab(Curve=move_2.Geometry, Option=slabopt)

# ---- group: Eixos estruturais
balanço_oeste = Slider(5, range=0..10, expression="x*-1")
balanço_sul = Slider(20, range=0..30, expression="x*-1")
balanço_leste = Slider(2.5, range=0..10, expression="x*-1")
balanço_norte = Slider(20, range=0..30, expression="x*-1")

# ----
Z_5 = UnitZ(Factor=pé_direito)
explode = Explode(Curve=move.Geometry, Recursive=True)  # -> Segments, Vertices
number_slider = Slider(10, range=0..10)
move_3 = Move(Geometry=explode.Segments, Motion=Z_5)  # -> Geometry, Transform
offset = Offset(
    Curve=explode.Segments,
    Distance=[balanço_oeste, balanço_sul, balanço_leste, balanço_norte],
    Plane=PlaneXY(0, 0, 0),
    Corners=1)  # -> simplify(Curve)
split = SplitTree(Data=simplify(move_3.Geometry), Masks=flatten("{(0 to 4)}[3]"))  # -> Positive, Negative
X = UnitX(Factor=number_slider)
mcx = MultipleCurves(Curves=offset)  # -> Points, IndexA, IndexB, ParamA, ParamB
division_3 = Division(A=comprimento_do_edifício, B=number_slider)
split_2 = SplitTree(Data=offset, Masks=flatten("{(2,4);(0,2)}"))  # -> Positive, Negative
arrlinear = LinearArray(Geometry=split.Positive, Direction=X, Count=expr("x+1", division_3))  # -> Geometry, Transform
pé_direito_2 = Number(pé_direito)
largura_da_vierendeel = Slider(0.4, range=0..1)
expression_2 = Expression(x=pé_direito_2, Expression="x/4")
split_3 = SplitTree(Data=arrlinear.Geometry, Masks=flatten("{0;3}"))  # -> flatten(Positive), Negative
split_4 = SplitTree(Data=offset, Masks=flatten("{1;(0,2)}"))  # -> flatten(Positive), Negative
number_slider_2 = Slider(0.8, range=0..1)
rectprof = RectangularProfile(Name="Montante Vierendeel", Width=expr("x/2", expression_2), Height=largura_da_vierendeel)
rectprof_2 = RectangularProfile(Name="Montante Vierendeel", Width=largura_da_vierendeel, Height=expression_2)
beamopt = BeamOption(Style={RefHandle=0, RefName=""}, Profile=rectprof_2, Align=1)
beam = Beam(Curve=arrlinear.Geometry, Option=beamopt)
rectprof_3 = RectangularProfile(Name="Montante Vierendeel", Width=expression_2, Height=largura_da_vierendeel)
subtraction = Subtraction(A=pé_direito_2, B=expression_2)
Z_6 = UnitZ(Factor=pé_direito)
mcx_2 = MultipleCurves(Curves=[split_3.Positive, split_4.Positive])  # -> Points, IndexA, IndexB, ParamA, ParamB
beamopt_2 = BeamOption(Style={RefHandle=0, RefName=""}, Profile=rectprof_2, Align=1)
columnopt = ColumnOption(Style={RefHandle=0, RefName=""}, Profile=rectprof_3, Align=4, Rotation=0, Height=subtraction)
columnopt_2 = ColumnOption(Style={RefHandle=0, RefName=""}, Profile=rectprof, Align=4, Rotation=0, Height=subtraction)
rectprof_4 = RectangularProfile(Name="Montante Vierendeel", Width=largura_da_vierendeel, Height=expression_2)
move_4 = Move(Geometry=split_2.Positive, Motion=Z_6)  # -> Geometry, Transform
split_5 = SplitTree(Data=simplify(offset), Masks=flatten("{0;?}"))  # -> flatten(Positive), Negative
circprof = CircularProfile(Name="New circular profile", Radius=number_slider_2)
divdist = DivideDistance(Curve=split_2.Positive, Distance=pé_direito)  # -> Points, Tangents, Parameters
panel = Panel("""0
-1""")
columnopt_3 = ColumnOption(Style={RefHandle=0, RefName=""}, Profile=rectprof_4, Align=4, Rotation=0, Height=pé_direito_2)
columnsty = ColumnStyle(Name="New column style", Profile=circprof, Sizes={RefHandle=0, RefName=""}, Height=2.7)
multiplication = Multiplication(A=pé_direito, B=número_de_pavimentos)
item = ListItem(List=divdist.Points, Index=panel, Wrap=True)  # -> simplify(Item)
mcx_3 = MultipleCurves(Curves=split_5.Positive)  # -> Points, IndexA, IndexB, ParamA, ParamB
column = Column(Position=mcx_2.Points, Option=columnopt_3)
exdiff = SetDifferenceS(SetA=divdist.Points, SetB=item)
columnopt_4 = ColumnOption(Style=columnsty, Profile=circprof, Align=4, Rotation=number_slider_2, Height=multiplication)
column_2 = Column(Position=mcx_3.Points, Option=columnopt_4)
column_3 = Column(Position=item, Option=columnopt_2)
column_4 = Column(Position=exdiff, Option=columnopt)
beam_2 = Beam(Curve=[split_2.Positive, move_4.Geometry], Option=beamopt_2)
