# Grasshopper definition Estudando o edifício orgânico.gh (Grasshopper 0.9.76)

ponto_de_toque_nordeste = Point(<point referenced from the Rhino model>)
ponto_de_toque_central = Point(<point referenced from the Rhino model>)
ponto_de_toque_oeste = Point(<point referenced from the Rhino model>)
Z = UnitZ(Factor=1)
cat = Catenary(PointA=ponto_de_toque_nordeste, PointB=ponto_de_toque_central, Length=Slider(67.4, range=0..100), Gravity=Z)
cat_2 = Catenary(PointA=ponto_de_toque_central, PointB=ponto_de_toque_oeste, Length=Slider(61.32, range=0..100), Gravity=Z)
cat_3 = Catenary(PointA=ponto_de_toque_oeste, PointB=ponto_de_toque_nordeste, Length=Slider(141, range=0..1000), Gravity=Z)
