# Grasshopper definition Estudo sobre curva base gerando edifício orgânico.gh (Grasshopper 0.9.76)
# plug-ins: Weaverbird

crv = Curve(<curve referenced from the Rhino model>)
pt = Point([<point referenced from the Rhino model> x11])
number_slider = Slider(34, range=0..100)
patch = Patch(Curves=crv, Points=pt, Spans=20, Flexibility=1, Trim=True)
divide = DivideDomain²(Domain=patch, UCount=number_slider, VCount=number_slider)
subsrf = Isotrim(Surface=patch, Domain=divide)
srfpt = SurfacePoints(Surface=patch)  # -> Points, Weights, Greville, UCount, VCount
del = DelaunayMesh(Points=srfpt.Points, Plane=PlaneXY(0, 0, 0))
wbtriangles = WeaverbirdsSplitTrianglesSubdivision(MeshCurves=del, Level=1)
