# Grasshopper definition caixa de elevadores e escada enclausurada.gh (Grasshopper 0.9.76)
# plug-ins: GhVa10

quantidade_de_elevadores_por_lado = Slider(2, range=0..10)
quantidade_de_pavimentos = Slider(12, range=0..100)
pé_direito = Slider(2.5, range=0..10)
rec = Rectangle({Plane=PlaneXY(960.9127591, -527.3506576, 796), Size=Domain2(u=0..5.000013814, v=0..9.999986186)})
box_corners = BoxCorners(Box=rec)  # -> CornerA, CornerB, CornerC, CornerD, CornerE, CornerF, CornerG, CornerH
column = Column(Position=[box_corners.CornerA, box_corners.CornerB, box_corners.CornerC, box_corners.CornerD], Option=null)
