# Grasshopper definition pavimentos do edifício organico.gh (Grasshopper 0.9.76)
# plug-ins: GhVa10

numero_de_pavimentos = Slider(5, range=0..10)
number_slider = Slider(5, range=0..10)
crv = Curve(<curve referenced from the Rhino model>)
srf = Surface(<surface referenced from the Rhino model>)
rec = Rectangle({Plane=PlaneXY(958.3999637, -527.3506576, 796), Size=Domain2(u=0..2.522795495, v=0..2.999972407)})
crv_2 = Curve(<curve referenced from the Rhino model>)
srf_2 = Surface(<surface referenced from the Rhino model>)
series = Series(Start=0, Step=number_slider, Count=numero_de_pavimentos)
series_2 = Series(Start=0, Step=number_slider, Count=numero_de_pavimentos)
Z = UnitZ(Factor=series)
Z_2 = UnitZ(Factor=series_2)
srf_3 = Surface(rec)
move = Move(Geometry=crv, Motion=Z_2)  # -> Geometry, Transform
move_2 = Move(Geometry=crv_2, Motion=Z)  # -> Geometry, Transform
Z_3 = UnitZ(Factor=expr("x/2", number_slider))
end = EndPoints(Curve=[move.Geometry, move_2.Geometry])  # -> Start, End
series_3 = Series(Start=expr("x/2", number_slider), Step=expr("x/2", number_slider), Count=expr("x*2", numero_de_pavimentos))
series_4 = Series(Start=number_slider, Step=number_slider, Count=numero_de_pavimentos)
move_3 = Move(Geometry=end.End, Motion=Z_3)  # -> Geometry, Transform
ln = Line(StartPoint=end.Start, EndPoint=move_3.Geometry)
Z_4 = UnitZ(Factor=series_4)
Z_5 = UnitZ(Factor=series_3)
move_4 = Move(Geometry=srf, Motion=Z_4)  # -> Geometry, Transform
move_5 = Move(Geometry=srf_3, Motion=Z_5)  # -> Geometry, Transform
scx = SurfaceCurve(Surface=srf_2, Curve=ln)  # -> Curves, flatten(Points), UVPoints, Normals, Parameters, Tangents
dist = Distance(PointA=scx.Points, PointB=end.Start)
srf_4 = Surface(move_5.Geometry)
project = Project(Curve=srf_2, Brep=move_4.Geometry, Direction=Vector(0, 0, 1))  # -> flatten(Curve)
subtraction = Subtraction(A=dist, B="3.5")
eval = EvaluateLength(Curve=ln, Length=subtraction, Normalized=False)  # -> Point, Tangent, Parameter
srfsplit = SurfaceSplit(Surface=move_4.Geometry, Curves=project)
shatter = Shatter(Curve=graft(ln), Parameters=graft(eval.Parameter))
graft = GraftTree(Tree=eval.Point, IncludeEmptyLists=True, IncludeNullItems=True)
item = ListItem(List=srfsplit, Index=0, Wrap=True)
item_2 = ListItem(List=shatter, Index=1, Wrap=True)
bbx = BrepBrep(BrepA=item, BrepB=srf_2)  # -> Curves, Points
graft_2 = GraftTree(Tree=item, IncludeEmptyLists=True, IncludeNullItems=True)
rotate = Rotate(Geometry=item_2, Angle=degrees(Slider(180, range=0..1000)), Plane=graft)  # -> Geometry, Transform
item_3 = ListItem(List=shatter, Index=0, Wrap=True)
panel = Panel("""2
2
1
1
1""")
srfsplit_2 = SurfaceSplit(Surface=graft_2, Curves=bbx.Curves)  # -> simplify(Fragments)
merge = Merge(Data1=rotate.Geometry, Data2=item_3)
graft_3 = GraftTree(Tree=panel, IncludeEmptyLists=True, IncludeNullItems=True)  # -> simplify(Tree)
curvepoint = PointOnCurve(merge, parameter=0.5)
X = UnitX(Factor=1)
item_4 = ListItem(List=srfsplit_2, Index=graft_3, Wrap=True)
hframe = HorizontalFrame(Curve=merge, Parameter=curvepoint)
deplane = DeconstructPlane(Plane=hframe)  # -> Origin, XAxis, YAxis, ZAxis
amp = Amplitude(Vector=deplane.YAxis, Amplitude=Slider(2.5, range=0..10))
extr = Extrude(Base=merge, Direction=amp)
slab = Slab(Curve=[extr, item_4], Option=null)
